# Grasshopper definition Flower03nataly.gh (Grasshopper 1.0.7)
# plug-ins: Kangaroo2 Components

number_slider = Slider(500, range=0..1000)
rectangle = Rectangle(Plane=PlaneXY(0, 0, 0), XSize=number_slider, YSize=number_slider, Radius=0)  # -> Rectangle, Length
unit_z = UnitZ(Factor=number_slider)

# ---- group: RH_IN:count
number_slider_2 = Slider(5, range=0..10)

# ----
extrude = Extrude(Base=rectangle.Rectangle, Direction=unit_z)
cap_holes = CapHoles(Brep=extrude)
brep = Brep(cap_holes)
pop3d = Populate3D(Region=brep, Count=200, Seed=number_slider_2)
brepsinc = PointInBreps(Brep=brep, Point=pop3d, Strict=False)  # -> Inside, Index

# ---- group: RH_IN:size
number_slider_3 = Slider(10, range=0..100)

# ----
dispatch = Dispatch(List=pop3d, DispatchPattern=brepsinc.Inside)  # -> ListA, ListB
division = Division(A=number_slider_3, B=-2)
prox = Proximity3D(Points=dispatch.ListA, Group=5)  # -> Links, Topology
rectangle_2 = Rectangle(Plane=PlaneXY(0, 0, 0), XSize=number_slider_3, YSize=number_slider_3, Radius=0)  # -> Rectangle, Length
flatten = FlattenTree(Tree=prox.Links, Path="{0}")
vec = VectorXYZ(XComponent=division, YComponent=division, ZComponent=0)  # -> Vector, Length
move = Move(Geometry=rectangle_2.Rectangle, Motion=vec.Vector)  # -> Geometry, Transform
dupln = RemoveDuplicateLines(Lines=flatten, Tolerance=0.01)
join = JoinCurves(Curves=move.Geometry, Preserve=False)
extrude_2 = ExtrudeLinear(Profile=join, OrientationP=PlaneXY(0, 0, 0), Axis=dupln)
cap = CapHoles(Brep=extrude_2)

# ---- group: RH_OUT:mesh
mesh = Mesh(cap)

# ----
mesh_edges = MeshEdges(Mesh=mesh)  # -> NakedEdges, InteriorEdges, NonManifoldEdges

# ---- group: RH_OUT:edges
curve = Curve([mesh_edges.NakedEdges, mesh_edges.InteriorEdges])
